# Grasshopper definition 02_How to use vector multiplication.gh (Grasshopper 1.0.7)

crv = Curve([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])
join = JoinCurves(Curves=crv, Preserve=False)
crv_2 = Curve([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])
crv_3 = Curve([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])
# 3 Level - 02
panel = Panel(crv_3)
explode = Explode(Curve=crv_3, Recursive=True)  # -> flatten(Segments), Vertices
explode_2 = Explode(Curve=join, Recursive=True)  # -> Segments, Vertices
shift = ShiftList(List=explode_2.Segments, Shift="-1", Wrap=True)
shift_2 = ShiftList(List=explode.Segments, Shift=1, Wrap=True)
vec = Vector(explode_2.Segments)
vec_2 = Vector(shift)
item = ListItem(List=shift, Index=0, Wrap=True)
angle = Angle(VectorA=explode.Segments, VectorB=shift_2)  # -> Angle, Reflex
multiplication = Multiplication(A=vec, B=vec_2)
box = Box()
num = Number(angle.Angle)
smaller = SmallerThan(FirstNumber=multiplication, SecondNumber="0")  # -> SmallerThan, OrEqualTo
sort = SortList(Keys=num, ValuesA=angle.Angle)  # -> Keys, ValuesA
cull = CullPattern(List=explode_2.Vertices, CullPattern=smaller.SmallerThan)
item_2 = ListItem(List=sort.ValuesA, Index=Slider(10, range=0..10), Wrap=True)
panel_2 = Panel(sort.ValuesA)
pline = PolyLine(Vertices=cull, Closed=False)
