# Grasshopper definition 04_Creating a tree branch shape using the given line.gh (Grasshopper 1.0.7)

number_slider = Slider(6, range=0..10)
X = UnitX(Factor=1)
# 3 Level - 04
xy = XYPlane(Origin=Point(0, 0, 0))
line = LineSDL(Start=xy, Direction=X, Length=Slider(10, range=0..10))
series = Series(Start=Slider(0, range=0..10), Step=Slider(3.5, range=0..10), Count=number_slider)
Z = UnitZ(Factor=series)
move = Move(Geometry=line, Motion=Z)  # -> Geometry, Transform
series_2 = Series(Start=0, Step=1, Count=number_slider)
_2º = PowerOf2(Value=series_2)
divide = DivideCurve(Curve=move.Geometry, Count=_2º, Kinks=False)  # -> Points, Tangents, Parameters
shatter = Shatter(Curve=graft(move.Geometry), Parameters=divide.Parameters)
midpt = CurveMiddle(Curve=shatter)
tstat = TreeStatistics(Tree=midpt)  # -> Paths, Length, Count
shift = ShiftList(List=tstat.Paths, Shift=1, Wrap=invert(True))
short = ShortestList(ListA=tstat.Paths, ListB=shift, TrimMode=2)  # -> ListA, ListB
branch = TreeBranch(Tree=midpt, Path=short.ListA, MaintainPaths=True)
branch_2 = TreeBranch(Tree=midpt, Path=short.ListB, MaintainPaths=True)
cps = ClosestPoints(Point=branch, Cloud=branch_2, Count="2")  # -> ClosestPoint, CPIndex, Distance
ln = Line(StartPoint=graft(branch), EndPoint=cps.ClosestPoint)
pshift = ShiftPaths(Data=ln, Offset=-1)  # -> simplify(Data)
dom = ConstructDomain(DomainStart=Slider(0.3, range=0..1), DomainEnd=Slider(0.1, range=0..0.1))
tstat_2 = TreeStatistics(Tree=pshift)  # -> Paths, Length, Count
range = Range(Domain=dom, Steps=expr("x - 1", tstat_2.Count))  # -> graft(Range)
pipe = Pipe(Curve=pshift, Radius=range, Caps=0)
cap = CapHoles(Brep=pipe)
