# Grasshopper definition 09_Creating a polyline by connecting points.gh (Grasshopper 1.0.7)

pt = Point(Tree({0;0}: [Point(8.360102611, 23.03302887, 0), Point(8.553503518, 13.43984358, 0)], {0;1}: [Point(17.06463073, 27.0165522, 0.9579941696), Point(17.06463073, 21.59253462, 4.654937278), Point(17.06463073, 15.77078763, 4.653572714), Point(17.06463073, 9.385434981, 1.626177295)], {0;2}: [Point(27.84526556, 24.06891358, 4.549172877), Point(27.84526556, 19.94086009, 7.041467193), Point(27.84526556, 16.12728719, 6.620386851), Point(27.84526556, 12.26803701, 2.769042926)], {0;3}: [Point(39.13667581, 27.11716779, 0), Point(39.13667581, 21.47096223, 5.760048053), Point(39.13667581, 15.65736813, 5.628133802), Point(39.13667581, 10.22893265, 1.56347406)], {0;4}: [Point(49.06322942, 25.38107834, 0), Point(49.34294195, 12.37331728, 0)]))
tstat = TreeStatistics(Tree=pt)  # -> Paths, Length, Count
panel = Panel("""0
-1""")
# 3 Level - 05
pline = PolyLine(Vertices=pt, Closed=False)
explode = Explode(Curve=pline, Recursive=True)  # -> Segments, Vertices
item = ListItem(List=tstat.Paths, Index=panel, Wrap=True)
cull_i = CullIndex(List=tstat.Paths, Indices=panel, Wrap=True)
branch = TreeBranch(Tree=pt, Path=cull_i, MaintainPaths=True)
branch_2 = TreeBranch(Tree=pt, Path=item, MaintainPaths=True)
panel_2 = Panel("""0
-1""")
ins = InsertItems(List=branch_2, Indices=panel_2, Wrap=True)
pshift = ShiftPaths(Data=ins, Offset=-1)
merge = Merge(Data1=pshift, Data2=branch)
flip = FlipMatrix(Data=merge)
pline_2 = PolyLine(Vertices=flip, Closed=False)
