# Grasshopper definition 15_making a gable roof.gh (Grasshopper 1.0.7)

crv = Curve([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])
pi = Pi(Factor=Slider(0.2, range=0..2))
explode = Explode(Curve=crv, Recursive=True)  # -> Segments, Vertices
kinkcrv = KinkyCurve(Vertices=explode.Vertices, Degree=Slider(3, range=0..10), Angle=pi)  # -> Curve, Length, Domain
disc = Discontinuity(Curve=kinkcrv.Curve, Level=1)  # -> Points, Parameters
neg = Negative(Value=Slider(4.1, range=0..100))
pline = PolyLine(Vertices=disc.Points, Closed=invert(False))
offset = OffsetCurve(Curve=pline, Distance=neg, Corners=1)
explode_2 = Explode(Curve=pline, Recursive=True)  # -> Segments, Vertices
explode_3 = Explode(Curve=offset, Recursive=True)  # -> Segments, Vertices
boundary = BoundarySurfaces(Edges=pline)  # -> simplify(Surfaces)
len = Length(Curve=explode_3.Segments)
panel = Panel("""0
1""")
sort = SortList(Keys=len, ValuesA=explode_2.Segments)  # -> Keys, ValuesA
cull_i = CullIndex(List=sort.ValuesA, Indices=panel, Wrap=True)
join = JoinCurves(Curves=cull_i, Preserve=False)
item = ListItem(List=join, Index=0, Wrap=True)
Z = UnitZ(Factor=Slider(6.7, range=0..10))
flip = FlipCurve(Curve=join, Guide=item)  # -> simplify(Curve), Flag
item_2 = ListItem(List=flip.Curve, Index=0, Wrap=True)  # -> Item, Item1
move = Move(Geometry=flip.Curve, Motion=Z)  # -> Geometry, Transform
extr = Extrude(Base=flip.Curve, Direction=Z)
explode_4 = Explode(Curve=item_2.Item, Recursive=True)  # -> graft(Segments), Vertices
explode_5 = Explode(Curve=item_2.Item1, Recursive=True)  # -> graft(Segments), Vertices
item_3 = ListItem(List=move.Geometry, Index=0, Wrap=True)  # -> Item, Item1
merge = Merge(Data1=explode_4.Segments, Data2=explode_5.Segments)
item_4 = ListItem(List=merge, Index=0, Wrap=True)  # -> Item, Item1
tweencrv = TweenCurve(CurveA=item_4.Item, CurveB=item_4.Item1, Factor=Slider(0.5, range=0..1), BlendType=0)
pshift = ShiftPaths(Data=tweencrv, Offset=-1)
Z_2 = UnitZ(Factor=Slider(10, range=0..10))
join_2 = JoinCurves(Curves=pshift, Preserve=False)
move_2 = Move(Geometry=join_2, Motion=Z_2)  # -> simplify(Geometry), Transform
merge_2 = Merge(Data1=item_3.Item, Data2=move_2.Geometry, Data3=item_3.Item1)
loft_opt = LoftOptions(Closed=False, Adjust=False, Rebuild=0, Refit=0, Type=Slider(3, range=0..10))
loft = Loft(Curves=merge_2, Options=loft_opt)
join_3 = BrepJoin(Breps=[boundary, loft, extr])  # -> Breps, Closed
cap = CapHoles(Brep=join_3.Breps)
panel_2 = Panel(loft)
